# Grasshopper definition Combined.gh (Grasshopper 0.9.76)
# plug-ins: Badger

panel = Panel("Flows")
panel_2 = Panel("Plants")
panel_3 = Panel("Floods")
manual_points = Point([<point referenced from the Rhino model> x13])

srf = Surface(<surface referenced from the Rhino model>)
sdivide = DivideSurface(Surface=srf, UCount=Slider(7, range=0..10), VCount=Slider(30, range=0..100))  # -> flatten(Points), Normals, Parameters
flows = FlowSimulation(Surface=srf, Points=sdivide.Points, Fidelity=Slider(50, range=0..100))  # -> C, P
crv = Curve(flows.C)
preview = CustomPreview(Geometry=crv, Shader=ColourSwatch(SwatchColor=RGB(0, 195, 255)))

generic_species = GenericSpeciesAttributes()  # -> ShrubP, GrassP, TreeP

colour = ColourPicker(PickedColour=RGBA(255, 0, 255, 106))
colour_2 = ColourPicker(PickedColour=RGBA(0, 255, 255, 105))
colour_3 = ColourPicker(PickedColour=RGBA(0, 119, 255, 107))
panel_4 = Panel("Colours")
colour_4 = ColourPicker(PickedColour=RGBA(67, 117, 255, 105))

coast = Curve(<curve referenced from the Rhino model>)
number_slider = Slider(10000, range=0..100000)
panel_5 = Panel("Testing Area")
construct_point = ConstructPoint(XCoordinate=Slider(0, range=-100000..0), YCoordinate=Slider(0, range=-1000..10000), ZCoordinate=0)
frontline = Curve(coast)
y_size = Number(number_slider)
x_size = Number(number_slider)
origin = Point(construct_point)

terrain = Brep(<brep referenced from the Rhino model>)

panel_6 = Panel("High Tide Data")
mean_high_water_springs = Slider(1000, range=0..5000)
mean_high_water_neaps = Slider(1450, range=0..5000)
mean_low_water_neaps = Slider(700, range=0..5000)
mean_low_water_springs = Slider(430, range=0..5000)
mean_sea_level = Slider(0, range=0..5000)

panel_7 = Panel("Site Data")
sea_level_rise_year = Slider(1.6, range=0..5)
storm_surge_height = Slider(500, range=0..5000)
sea_datum_z = Slider(0, range=-3000..3000)
year = Slider(2068, range=2015..2115)

terrain_2 = Brep(terrain)

num = Number(sea_datum_z)
num_2 = Number(year)
origin_2 = Point(origin)
num_3 = Number(sea_level_rise_year)
num_4 = Number(mean_high_water_springs)
num_5 = Number(mean_low_water_springs)
x_size_2 = Number(x_size)
num_6 = Number(mean_sea_level)
num_7 = Number(mean_high_water_neaps)
num_8 = Number(mean_low_water_neaps)
y_size_2 = Number(y_size)
num_9 = Number(storm_surge_height)
mean_high_water_neap = Geometry()
mean_high_water_spring = Geometry()
mean_low_water_spring = Geometry()
mean_low_water_neap = Geometry()
mean_sea_level_2 = Geometry()
storm_surge_level = Geometry()

frontline_2 = Curve(frontline)
storm_surge_level_2 = Geometry(storm_surge_level)
mean_high_water_spring_2 = Geometry(mean_high_water_spring)
terrain_3 = Brep(terrain_2)
mean_high_water_neap_2 = Geometry(mean_high_water_neap)
mean_low_water_neap_2 = Geometry(mean_low_water_neap)
mean_low_water_spring_2 = Geometry(mean_low_water_spring)
mean_sea_level_3 = Geometry(mean_sea_level_2)
cluster = Cluster(level=mean_sea_level_3, frontline=frontline_2, terrain=terrain_3)  # -> curve_3, list
cluster_2 = Cluster(level=mean_low_water_neap_2, frontline=frontline_2, terrain=terrain_3)  # -> curve_3, list
cluster_3 = Cluster(level=storm_surge_level_2, frontline=frontline_2, terrain=terrain_3)  # -> curve_3, list
cluster_4 = Cluster(level=mean_high_water_neap_2, frontline=frontline_2, terrain=terrain_3)  # -> curve_3, list
cluster_5 = Cluster(level=mean_low_water_spring_2, frontline=frontline_2, terrain=terrain_3)  # -> curve_3, list
cluster_6 = Cluster(level=mean_high_water_spring_2, frontline=frontline_2, terrain=terrain_3)  # -> curve_3, list
mean_sea_level_srf = CustomPreview(Geometry=cluster.list, Shader=colour_3)
mean_sea_level_srf_2 = CustomPreview(Geometry=cluster_2.list, Shader=colour_3)
mean_sea_level_srf_3 = CustomPreview(Geometry=cluster_4.list, Shader=colour_3)
mean_sea_level_srf_4 = CustomPreview(Geometry=cluster_5.list, Shader=colour_3)
mean_sea_level_srf_5 = CustomPreview(Geometry=cluster_6.list, Shader=colour_3)
mean_sea_level_srf_6 = CustomPreview(Geometry=cluster_3.list, Shader=colour_3)
mean_sea_level_crv = CustomPreview(Geometry=cluster.curve_3, Shader=colour_3)
mean_sea_level_crv_2 = CustomPreview(Geometry=cluster_2.curve_3, Shader=colour_3)
mean_sea_level_crv_3 = CustomPreview(Geometry=cluster_4.curve_3, Shader=colour_3)
mean_sea_level_crv_4 = CustomPreview(Geometry=cluster_5.curve_3, Shader=colour_3)
mean_sea_level_crv_5 = CustomPreview(Geometry=cluster_6.curve_3, Shader=colour_3)
mean_sea_level_crv_6 = CustomPreview(Geometry=cluster_3.curve_3, Shader=colour_3)

month = Slider(1, range=1..12)
day = Slider(1, range=1..31)
month_2 = Slider(1, range=1..12)
day_2 = Slider(1, range=1..31)
crv_2 = Curve(<curve referenced from the Rhino model>)
file = ReadFile(File="Z:\Code\badger\Examples\Combined.csv", PerLineParse=True)
boundary = BoundarySurfaces(Edges=crv_2)
planted_date = ConstructDate(Year=Slider(2015, range=2015..2100), Month=month, Day=day, Hour=12, Minute=0, Second=0)
simulated_date = ConstructDate(Year=Slider(2016, range=2014..2100), Month=month_2, Day=day_2, Hour=12, Minute=0, Second=0)
placer = PlantPlacementSolver(Plants=generic_species.ShrubP, Area=boundary)  # -> Plants, Locations
grower = PlantGrowthSimulator(Plants=placer.Plants, End=simulated_date, Start=planted_date)  # -> Plants, Grown

pimport = SpeciesAttributeImporter(CSVFile=file)

placer_2 = PlantPlacementSolver(Plants=pimport, Area=boundary)  # -> Plants, Locations
grower_2 = PlantGrowthSimulator(Plants=placer_2.Plants, End=simulated_date, Start=planted_date)  # -> Plants, Grown
shower = PlantAppearanceSimulator(Plants=grower_2.Plants)  # -> Trunk, Root, Crown, Spacing

shower_2 = PlantAppearanceSimulator(Plants=pimport, Locations=manual_points)  # -> Trunk, Root, Crown, Spacing
circle = Circle(shower_2.Root)
circle_2 = Circle(shower_2.Crown)
circle_3 = Circle(shower_2.Trunk)
circle_4 = Circle(shower_2.Spacing)

# ==== cluster Cluster
level = ClusterInput()
frontline = ClusterInput()
terrain = ClusterInput()
level_2 = Brep(level)
terrain_2 = Brep(terrain)
bbx = BrepBrep(BrepA=terrain_2, BrepB=level_2)  # -> Curves, Points
find_closest = FindClosest(curve=bbx.Curves, curve_2=frontline)
split_with_brep = SplitWithBrep(Curve=level_2, Brep=terrain_2)  # -> Curve, Points
find_closest_2 = FindClosest(curve=split_with_brep.Curve, curve_2=frontline)
curve = Curve(find_closest)
list_item = ListItem(List=find_closest_2, Index=1, Wrap=True)
join_curves = JoinCurves(Curves=[curve, list_item], Preserve=False)
boundary_surfaces = BoundarySurfaces(Edges=join_curves)
list_length = ListLength(List=bbx.Curves)
larger_than = LargerThan(FirstNumber=list_length, SecondNumber=0)  # -> LargerThan, OrEqualTo
cull_pattern = CullPattern(List=boundary_surfaces, CullPattern=larger_than.LargerThan)
curve_2 = Curve(find_closest)
curve_3 = ClusterOutput(curve_2)
list = ClusterOutput(cull_pattern)

# ==== cluster FindClosest
curve = ClusterInput()
curve_2 = ClusterInput()
divide_curve = DivideCurve(Curve=curve_2, Count=2, Kinks=False)  # -> Points, Tangents, Parameters
divide_curve_2 = DivideCurve(Curve=curve, Count=2, Kinks=False)  # -> Points, Tangents, Parameters
list_item = ListItem(List=divide_curve_2.Points, Index=1, Wrap=True)  # -> flatten(Item)
list_item_2 = ListItem(List=divide_curve.Points, Index=1, Wrap=True)
distance = Distance(PointA=list_item, PointB=list_item_2)
sort_list = SortList(Keys=distance)  # -> Keys, ValuesValuesA
list_item_3 = ListItem(List=sort_list.Keys, Index=0, Wrap=True)
member_index = MemberIndex(Set=distance, Member=list_item_3)  # -> Index, Count
list_item_4 = ListItem(List=curve, Index=member_index.Index, Wrap=True)
i = ClusterOutput(list_item_4)
