# Grasshopper definition Groundhog - Flows Examples.ghx (Grasshopper 0.9.76)
# plug-ins: Groundhog

flow_step_size = Slider(50, range=0..100)
# Definition prepared for Groundhog v0.7.0b and depends on components from that plugin. It is available for download at http://groundhog.la/
# 
# Contact groundhog@philipbelesky.com for support or feedback.
# 
# This is an example file related to the plugin's documentation.
# 
# This definition is licensed under the terms of the GPL v3 https://opensource.org/licenses/GPL-3.0
# Example 1 (Lower-Left)
number_slider = Slider(15, range=0..50)

# ----
# Example 2 (Upper-Right)
proximity_threshold = Slider(100, range=0..100)
flow_step_size_2 = Slider(25, range=0..100)
flow_step_limit = Slider(75, range=0..100)
random_points_count = Slider(150, range=0..1000)
multithread = BooleanToggle(True)

# ---- group: Base Surface
# Groundhog Example File
srf = Surface(<surface referenced from the Rhino model>)

# ---- group: Base Mesh
mesh = Mesh(<mesh referenced from the Rhino model>)

# ---- group: Create point grid for path starts
sdivide = DivideSurface(Surface=srf, UCount=number_slider, VCount=Slider(15, range=0..50))  # -> flatten(Points), Normals, Parameters

# ---- group: Distribute points randomly on mesh for path starts
cluster = Cluster(C=mesh, N=random_points_count)

# ---- group: Calculate the flow paths (for mesh)
mesh_flows = FlowSimulationMesh(Mesh=mesh, Points=cluster, Fidelity=flow_step_size_2, Steps=flow_step_limit, Thread=multithread)  # -> FlowPoints, FlowPaths

# ---- group: Calculate the flow paths (for surface)
srf_flows = FlowSimulationSurface(Surface=srf, Points=sdivide.Points, Fidelity=flow_step_size, Steps=0, Thread=False)  # -> FlowPoints, FlowPaths

# ---- group: Calculate catchment bounds
catchments = FlowCatchments(FlowPaths=mesh_flows.FlowPaths, ProximtyThreshold=proximity_threshold)  # -> Catchments, FlowPaths, ColorCodes

catchments_2 = FlowCatchments(FlowPaths=srf_flows.FlowPaths, ProximtyThreshold=Slider(25, range=0..100))  # -> Catchments, FlowPaths, ColorCodes

# ---- group: Color flow paths by length from source
explode = Explode(Curve=catchments_2.FlowPaths, Recursive=True)  # -> Segments, Vertices
minimum_luminance = Slider(0.7, range=0..1)
luminance_step = Slider(-0.02, range=-1..0.1)
lng = ListLength(List=explode.Segments)
series = Series(Start=1, Step=luminance_step, Count=lng)
max = Maximum(A=series, B=minimum_luminance)
hsl = ColourHSL(Alpha=1, Hue=0, Saturation=0, Luminance=max)
preview = CustomPreview(Geometry=explode.Segments, Shader=hsl)

# ---- group: Color code catchment boundaries
preview_2 = CustomPreview(Geometry=catchments_2.Catchments, Shader=catchments_2.ColorCodes)

# ---- group: Color code flow paths by catchment
preview_3 = CustomPreview(Geometry=catchments.FlowPaths, Shader=catchments.ColorCodes)

# ---- group: Create and color a naïve flooding extents from end points
pooling_radius = Slider(1500, range=0..3000)
sampling_accuracy = Slider(10, range=0..1000)
pooling_color = ColourSwatch(SwatchColor=RGB(128, 132, 180))
end = EndPoints(Curve=mesh_flows.FlowPaths)  # -> Start, End
pdecon = Deconstruct(Point=end.End)  # -> XComponent, YComponent, ZComponent
pt = ConstructPoint(XCoordinate=pdecon.XComponent, YCoordinate=pdecon.YComponent, ZCoordinate=0)
lng_2 = ListLength(List=pt)
repeat = RepeatData(Data=pooling_radius, Length=lng_2)
metaball_t = MetaBallTCustom(Points=pt, Charge=repeat, Plane=PlaneXY(0, 0, 0), Threshold=0.5, Accuracy=sampling_accuracy)

# ----
simplify = SimplifyCurve(Curve=metaball_t, Tolerance=5, AngleTolerance=1)  # -> Curve, Simplified

# ---- group: Create and color a naïve flooding extents from end points (continued)
boundary = BoundarySurfaces(Edges=simplify.Curve)
preview_4 = CustomPreview(Geometry=boundary, Shader=pooling_color)

# ==== cluster Cluster
N = ClusterInput()
C = ClusterInput()
bbox = BoundingBox(Content=C, Plane=PlaneXY(0, 0, 0))  # -> Box, Box_2
debrep = DeconstructBrep(Brep=bbox.Box)  # -> Faces, Edges, Vertices
item = ListItem(List=debrep.Faces, Index=Slider(5, range=0..10), Wrap=True)
pop2d = Populate2D(Region=item, Count=N, Seed=1)
project = ProjectPoint(Point=pop2d, Direction=Vector(0, 0, -1), Geometry=C)  # -> Point, Index
P = ClusterOutput(project.Point)
